# Dynamo graph Rebar.dyn (Dynamo 2.5.0.7460)
# packages: Structural Design 2020.4.10

categories = Categories("OST_StructuralFraming")
all_elements_of_category = ElementsOfCategory(Category=categories)
file_path = Filename("..\鉄筋.xlsx")
file_from_path = FileObject(path=file_path)
code_block = CodeBlock { "RC_Girder"; }
boolean = BoolSelector(true)
importExcel = Data.ImportExcel(file=file_from_path, sheetName=code_block, showExcel=boolean)
code_block_2 = CodeBlock { [0,1,2,3]; }
removeItemAtIndex = List.RemoveItemAtIndex(list=importExcel, indices=code_block_2)
code_block_3 = CodeBlock { 0; }
removeItemAtIndex_2 = List.RemoveItemAtIndex(list=removeItemAtIndex@L2, indices=code_block_3)
transpose = List.Transpose(lists=removeItemAtIndex_2)
firstItem = List.FirstItem(list=transpose)
code_block_4 = CodeBlock { 1; }
getItemAtIndex = List.GetItemAtIndex(list=importExcel, index=code_block_4)
code_block_5 = CodeBlock { [0,1]; }
removeItemAtIndex_3 = List.RemoveItemAtIndex(list=getItemAtIndex, indices=code_block_5)
count = List.Count(list=firstItem)
cycle = List.Cycle(list=removeItemAtIndex_3, amount=count)
count_2 = List.Count(list=removeItemAtIndex_3)
chop = List.Chop(list=cycle, lengths=count_2)
code_block_6 = CodeBlock { 0; }
removeItemAtIndex_4 = List.RemoveItemAtIndex(list=removeItemAtIndex_2@L2, indices=code_block_6)
code_block_7 = CodeBlock { "Comments"; }
python_script = Python(IN[0]=all_elements_of_category, IN[1]=firstItem, IN[2]=chop, IN[3]=removeItemAtIndex_4, IN[4]=code_block_7)
# ---------- python_script.python (17 lines) ----------
# Load the Python Standard and DesignScript Libraries
import sys
import clr
clr.AddReference('ProtoGeometry')
from Autodesk.DesignScript.Geometry import *

# The inputs to this node will be stored as a list in the IN variables.
familyInstances = IN[0]
listBeamNames=IN[1]
listBeamParameter=IN[2]
listBeamValue=IN[3]
nameBeam=IN[4]

# Place your code below this line

# Assign your output to the OUT variable.
OUT = listBeamValue
# ----------------------------------------
string = StringInput("G1")
indexOf = List.IndexOf(list=firstItem, element=string)
getItemAtIndex_2 = List.GetItemAtIndex(list=chop, index=indexOf)
getItemAtIndex_3 = List.GetItemAtIndex(list=removeItemAtIndex_4, index=indexOf)
byKeysValues = DesignScript.Builtin.Dictionary.ByKeysValues(keys=getItemAtIndex_2, values=getItemAtIndex_3)
string_2 = StringInput("始端_上端筋径")
valueAtKey = DesignScript.Builtin.Dictionary.ValueAtKey(dictionary=byKeysValues, key=string_2)
python_script_2 = Python()  # unwired: IN[0], IN[1], IN[2], IN[3], IN[4]
# ---------- python_script_2.python (34 lines) ----------
# Load the Python Standard and DesignScript Libraries
import sys
import clr
clr.AddReference('ProtoGeometry')
from Autodesk.DesignScript.Geometry import *

# The inputs to this node will be stored as a list in the IN variables.
numberStartTop1 = IN[0]
cover=IN[1]
lineBeam=IN[2]
width= IN[3]
height=IN[4]

startPoint= lineBeam[0].StartPoint
endPoint=lineBeam[0].EndPoint

widthRebar= width-2*cover
heightRebar= height-2*cover

spacingHorizontal= widthRebar/(numberStartTop1-1)

pointStartTop1Y= startPoint.Y-widthRebar/2
pointEndTop1Y= endPoint.Y-widthRebar/2

pointStartTop1Z= startPoint.Z-cover
pointEntTop1Z= endPoint.Z-cover

point1= Point.ByCoordinates(startPoint.X,pointStartTop1Y,pointStartTop1Z)
point2= Point.ByCoordinates(endPoint.X,pointEndTop1Y,pointEntTop1Z)

#listTop1=[point1.ToPoint(point1),point2]
line1= Line.ByStartPointEndPoint(point1,point2)
# Assign your output to the OUT variable.
OUT = line1
# ----------------------------------------
python_script_3 = Python()  # unwired: IN[0], IN[1], IN[2], IN[3], IN[4], IN[5], IN[6], IN[7], IN[8], IN[9]
# ---------- python_script_3.python (50 lines) ----------
# Enable Python support and load DesignScript library
import clr
clr.AddReference('ProtoGeometry')
from Autodesk.DesignScript.Geometry import *

# Import ToDSType(bool) extension method
clr.AddReference('RevitNodes')
import Revit
clr.ImportExtensions(Revit.Elements)

# Import DocumentManager and TransactionManager
clr.AddReference('RevitServices')
import RevitServices
from RevitServices.Persistence import DocumentManager
from RevitServices.Transactions import TransactionManager

# Import RevitAPI
clr.AddReference('RevitAPI')
import Autodesk
from Autodesk.Revit.DB.Structure import Rebar, RebarContainerType, RebarContainer, RebarShape, RebarBarType, RebarHookType, RebarLayoutRule,RebarStyle, RebarHookOrientation
from Autodesk.Revit.DB import LocationPoint, XYZ, FilteredElementCollector, ElementFilter

# The inputs to this node will be stored as a list in the IN variables.
line=UnwrapElement(IN[0])
rebarShape=UnwrapElement(IN[1])
rebarBarType=UnwrapElement(IN[2])

startHookType=UnwrapElement(IN[3])
endHookType=UnwrapElement(IN[4])

startHookOrientation=RebarHookOrientation.Right
endHookOritation=RebarHookOrientation.Right

hostElement=UnwrapElement(IN[7])
vector=UnwrapElement(IN[8])

rebarStyle =RebarStyle.Standard

vectorRevit=XYZ(vector.X,vector.Y,vector.Z)
listCurve=[]
listCurve.append(line)
# Place your code below this line
doc = DocumentManager.Instance.CurrentDBDocument
# Start transaction
TransactionManager.Instance.EnsureInTransaction(doc)
rebar = Rebar.CreateFromCurves(doc, rebarStyle, rebarBarType, startHookType, endHookType, hostElement, vectorRevit, listCurve, startHookOrientation, endHookOritation, True, True)
# End transaction
TransactionManager.Instance.TransactionTaskDone()
# Assign your output to the OUT variable.
OUT =listCurve
# ----------------------------------------
string_3 = StringInput("Comments")
getParameterValueByName = Element.GetParameterValueByName(element=all_elements_of_category, parameterName=string_3)
python_script_4 = Python(IN[0]=all_elements_of_category, IN[1]=getParameterValueByName, IN[2]=string)
# ---------- python_script_4.python (20 lines) ----------
# Load the Python Standard and DesignScript Libraries
import sys
import clr
clr.AddReference('ProtoGeometry')
from Autodesk.DesignScript.Geometry import *

# The inputs to this node will be stored as a list in the IN variables.
allElement = IN[0]
listParameterValue= IN[1]
valueParameter=IN[2]

listResult=[]
for i in range(0,len(listParameterValue)):
    if(listParameterValue[i]==valueParameter):
        listResult.append(allElement[i])

# Place your code below this line

# Assign your output to the OUT variable.
OUT = listResult
# ----------------------------------------
getLocation = Element.GetLocation(element=python_script_4)
code_block_8 = CodeBlock(rebar=byKeysValues)
# ---------- code_block_8.designscript (5 lines) ----------
rebar;
mainStartUp1=Dictionary.ValueAtKey(rebar,"始端_上端筋_1段主筋本数");
rebarTypeStartUp1= Dictionary.ValueAtKey(rebar,"始端_上端筋径");
mainStartBottom1=Dictionary.ValueAtKey(rebar,"始端_下端筋_1段主筋本数");
rabarTypeStartBottom1=Dictionary.ValueAtKey(rebar,"始端_下端筋径");
# ----------------------------------------
cycle_2 = List.Cycle(list=getLocation, amount=code_block_8.mainStartUp1)
faces = Element.Faces(element=python_script_4)
startPoint = Curve.StartPoint(curve=getLocation)
normalAtPoint = Surface.NormalAtPoint(surface=faces, point=startPoint)
flatten = List.Flatten(list=normalAtPoint)
ZAxis = Vector.ZAxis()
dot = Vector.Dot(vector=flatten, vec=ZAxis)
code_block_9 = CodeBlock { 0; }
eq = Equals(x=dot, y=code_block_9)
filterByBoolMask = List.FilterByBoolMask(list=flatten, mask=eq)
direction = Line.Direction(line=getLocation)
normalized = Vector.Normalized(vector=direction)
dot_2 = Vector.Dot(vector=filterByBoolMask.in, vec=normalized)
eq_2 = Equals(x=dot_2, y=code_block_9)
filterByBoolMask_2 = List.FilterByBoolMask(list=filterByBoolMask.in, mask=eq_2)
firstItem_2 = List.FirstItem(list=filterByBoolMask_2.in@L2)
firstItem_3 = List.FirstItem(list=python_script_4)
elementType = Element.ElementType(element=firstItem_3)
string_4 = StringInput("B_c")
getParameterValueByName_2 = Element.GetParameterValueByName(element=elementType, parameterName=string_4)
rebar_cover = CodeBlock { 25; }
python_script_5 = Python(IN[0]=getParameterValueByName_2, IN[1]=code_block_8.mainStartUp1, IN[2]=rebar_cover)
# ---------- python_script_5.python (48 lines) ----------
# Load the Python Standard and DesignScript Libraries
import sys
import clr
clr.AddReference('ProtoGeometry')
from Autodesk.DesignScript.Geometry import *

# The inputs to this node will be stored as a list in the IN variables.
width = IN[0]
number=int(IN[1])
cover= IN[2]

widthRebar= width-2*cover
distance= widthRebar/(number-1)
listSpacing= []
isLeftFirst=True
spaceLeft=0
isRightFirst=True
spaceRight=0
if(number % 2==0):
    for i in range(0,number):
        if(i<=number/2-1):
            if(isLeftFirst):
                spaceLeft=distance/2
                listSpacing.append(spaceLeft)
                isLeftFirst=False
            else:
                 spaceLeft+=distance
                 listSpacing.append(spaceLeft)
        else:
            if(isRightFirst):
                spaceRight= -distance/2
                listSpacing.append(spaceRight)
                isRightFirst=False
            else:
                spaceRight-=distance
                listSpacing.append(spaceRight)
else:
    for i in range(0,number-1):
        if(i<(number-1)/2):
            spaceLeft+=distance
            listSpacing.append(spaceLeft)
        else:
            spaceRight-=distance
            listSpacing.append(spaceRight)
    listSpacing.append(0)

# Assign your output to the OUT variable.
OUT = listSpacing
# ----------------------------------------
translate = Geometry.Translate(geometry=cycle_2, direction=firstItem_2, distance=python_script_5, lacing=Longest)
dot_3 = Vector.Dot(vector=filterByBoolMask.out, vec=normalized)
eq_3 = Equals(x=dot_3, y=code_block_9)
filterByBoolMask_3 = List.FilterByBoolMask(list=filterByBoolMask.out, mask=eq_3)
ZAxis_2 = Vector.ZAxis()
dot_4 = Vector.Dot(vector=filterByBoolMask_3.in, vec=ZAxis_2)
code_block_10 = CodeBlock { 0; }
lt = dot_4 < code_block_10
filterByBoolMask_4 = List.FilterByBoolMask(list=filterByBoolMask_3.in, mask=lt)
firstItem_4 = List.FirstItem(list=filterByBoolMask_4.in)
translate_2 = Geometry.Translate(geometry=translate, direction=firstItem_4, distance=rebar_cover, lacing=Longest)
rebarStyle = RevitRebarStyle("Standard")
element_types = ElementTypes("RebarBarType")
all_elements_of_type = ElementsOfType(element_type=element_types)
string_5 = StringInput("Type Name")
getParameterValueByName_3 = Element.GetParameterValueByName(element=all_elements_of_type, parameterName=string_5)
indexOf_2 = List.IndexOf(list=getParameterValueByName_3, element=code_block_8.rebarTypeStartUp1)
getItemAtIndex_4 = List.GetItemAtIndex(list=all_elements_of_type, index=indexOf_2)
rebarHookType = RevitRebarHookType("鉄筋フック 90")
rebarHookOrientation = RevitRebarHookOrientation("Right")
fromCurve = StructuralDesign.Rebar.Create.FromCurve(curve=translate_2, rebarStyle=rebarStyle, rebarBarType=getItemAtIndex_4, startHookType=rebarHookType, endHookType=rebarHookType, startHookOrientation=rebarHookOrientation, endHookOrientation=rebarHookOrientation, hostElement=python_script_4, vector=firstItem_2, lacing=Longest)
python_script_6 = Python(IN[0]=getParameterValueByName_2, IN[1]=code_block_8.mainStartBottom1, IN[2]=rebar_cover)  # same code as python_script_5
translate_3 = Geometry.Translate(geometry=cycle_2, direction=firstItem_2, distance=python_script_6, lacing=Longest)
string_6 = StringInput("D_c")
getParameterValueByName_4 = Element.GetParameterValueByName(element=elementType, parameterName=string_6)
code_block_11 = CodeBlock(height=getParameterValueByName_4, cover=rebar_cover) { height-cover; }
translate_4 = Geometry.Translate(geometry=translate_3, direction=firstItem_4, distance=code_block_11, lacing=Longest)
rebarStyle_2 = RevitRebarStyle("Standard")
indexOf_3 = List.IndexOf(list=getParameterValueByName_3, element=code_block_8.rabarTypeStartBottom1)
getItemAtIndex_5 = List.GetItemAtIndex(list=all_elements_of_type, index=indexOf_3)
rebarHookType_2 = RevitRebarHookType("鉄筋フック 90")
rebarHookOrientation_2 = RevitRebarHookOrientation()  # nothing selected
fromCurve_2 = StructuralDesign.Rebar.Create.FromCurve(curve=translate_4, rebarStyle=rebarStyle_2, rebarBarType=getItemAtIndex_5, startHookType=rebarHookType_2, endHookType=rebarHookType_2, startHookOrientation=rebarHookOrientation_2, endHookOrientation=rebarHookOrientation_2, hostElement=python_script_4, vector=firstItem_2, lacing=Longest)
