# Dynamo graph RebarV6.dyn "Rebar" (Dynamo 2.5.0.7460)
# packages: Structural Design 2021.1.22, Dynamo for Rebar 2.0.2

select_model_element = DSModelElementSelection()  # 1 picked in the model; graph input
getLocation = Element.GetLocation(element=select_model_element)
lengthRebarAtStart = CodeBlock { 1/4; }
trimByEndParameter = Curve.TrimByEndParameter(curve=getLocation, endParameter=lengthRebarAtStart)
faces = Element.Faces(element=select_model_element)
startPoint = Curve.StartPoint(curve=getLocation)
normalAtPoint = Surface.NormalAtPoint(surface=faces, point=startPoint)
ZAxis = Vector.ZAxis()
dot = Vector.Dot(vector=normalAtPoint, vec=ZAxis)
code_block = CodeBlock { 0; }
eq = dot == code_block
filterByBoolMask = List.FilterByBoolMask(list=normalAtPoint, mask=eq)
direction = Line.Direction(line=getLocation)
normalized = Vector.Normalized(vector=direction)
dot_2 = Vector.Dot(vector=filterByBoolMask.in, vec=normalized)
eq_2 = dot_2 == code_block
filterByBoolMask_2 = List.FilterByBoolMask(list=filterByBoolMask.in, mask=eq_2)
firstItem = List.FirstItem(list=filterByBoolMask_2.in@L2)
elementType = Element.ElementType(element=select_model_element)
string = StringInput("Width")
getParameterValueByName = Element.GetParameterValueByName(element=elementType, parameterName=string)
file_path = Filename("..\鉄筋.xlsx")  # graph input
file_from_path = FileObject(path=file_path)
code_block_2 = CodeBlock { "RC_Girder"; }
boolean = BoolSelector(true)
importExcel = Data.ImportExcel(file=file_from_path, sheetName=code_block_2, showExcel=boolean)
code_block_3 = CodeBlock { 1; }
getItemAtIndex = List.GetItemAtIndex(list=importExcel, index=code_block_3)
code_block_4 = CodeBlock { [0,1]; }
removeItemAtIndex = List.RemoveItemAtIndex(list=getItemAtIndex, indices=code_block_4)
code_block_5 = CodeBlock { [0,1,2,3]; }
removeItemAtIndex_2 = List.RemoveItemAtIndex(list=importExcel, indices=code_block_5)
code_block_6 = CodeBlock { 0; }
removeItemAtIndex_3 = List.RemoveItemAtIndex(list=removeItemAtIndex_2@L2, indices=code_block_6)
transpose = List.Transpose(lists=removeItemAtIndex_3)
firstItem_2 = List.FirstItem(list=transpose)
count = List.Count(list=firstItem_2)
cycle = List.Cycle(list=removeItemAtIndex, amount=count)
count_2 = List.Count(list=removeItemAtIndex)
chop = List.Chop(list=cycle, lengths=count_2)
string_2 = StringInput("Comments")
getParameterValueByName_2 = Element.GetParameterValueByName(element=select_model_element, parameterName=string_2)
indexOf = List.IndexOf(list=firstItem_2, element=getParameterValueByName_2)
getItemAtIndex_2 = List.GetItemAtIndex(list=chop, index=indexOf)
code_block_7 = CodeBlock { 0; }
removeItemAtIndex_4 = List.RemoveItemAtIndex(list=removeItemAtIndex_3@L2, indices=code_block_7)
getItemAtIndex_3 = List.GetItemAtIndex(list=removeItemAtIndex_4, index=indexOf)
byKeysValues = DesignScript.Builtin.Dictionary.ByKeysValues(keys=getItemAtIndex_2, values=getItemAtIndex_3)
code_block_8 = CodeBlock(rebar=byKeysValues)
# ---------- code_block_8.designscript (29 lines) ----------
rebar;
mainStartUp1=Dictionary.ValueAtKey(rebar,"始端_上端筋_1段主筋本数");
rebarTypeStartUp= Dictionary.ValueAtKey(rebar,"始端_上端筋径");
mainStartBottom1=Dictionary.ValueAtKey(rebar,"始端_下端筋_1段主筋本数");
rabarTypeStartBottom1=Dictionary.ValueAtKey(rebar,"始端_下端筋径");
distanceOfStirrup= Dictionary.ValueAtKey(rebar,"中央_肋筋ピッチ");
diameterOfStirrup= Dictionary.ValueAtKey(rebar,"中央_肋筋径");
numberOfStirrup= Dictionary.ValueAtKey(rebar,"中央_肋筋本数");
mainStartUp2=Dictionary.ValueAtKey(rebar,"始端_上端筋_2段主筋本数");
mainStartUp3=Dictionary.ValueAtKey(rebar,"始端_上端筋_3段主筋本数");
mainStartBottom2=Dictionary.ValueAtKey(rebar,"始端_下端筋_2段主筋本数");
mainStartBottom3=Dictionary.ValueAtKey(rebar,"始端_下端筋_3段主筋本数");
mainMiddleTop1= Dictionary.ValueAtKey(rebar,"中央_上端筋_1段主筋本数");
mainMiddleTop2= Dictionary.ValueAtKey(rebar,"中央_上端筋_2段主筋本数");
mainMiddleTop3= Dictionary.ValueAtKey(rebar,"中央_上端筋_3段主筋本数");
rebarTypeMiddleTop=Dictionary.ValueAtKey(rebar,"中央_上端筋径");
mainMiddleBottom1= Dictionary.ValueAtKey(rebar,"中央_下端筋_1段主筋本数");
mainMiddleBottom2= Dictionary.ValueAtKey(rebar,"中央_下端筋_2段主筋本数");
mainMiddleBottom3= Dictionary.ValueAtKey(rebar,"中央_下端筋_3段主筋本数");
rebarTypeMiddleBottom=Dictionary.ValueAtKey(rebar,"中央_下端筋径");
mainEndUp1=Dictionary.ValueAtKey(rebar,"終端_上端筋_1段主筋本数");
mainEndUp2=Dictionary.ValueAtKey(rebar,"終端_上端筋_2段主筋本数");
mainEndUp3=Dictionary.ValueAtKey(rebar,"終端_上端筋_3段主筋本数");
rebarTypeEndUp= Dictionary.ValueAtKey(rebar,"終端_上端筋径");
mainEndBottom1=Dictionary.ValueAtKey(rebar,"終端_下端筋_1段主筋本数");
mainEndBottom2=Dictionary.ValueAtKey(rebar,"終端_下端筋_2段主筋本数");
mainEndBottom3=Dictionary.ValueAtKey(rebar,"終端_下端筋_3段主筋本数");
rebarTypeEndBottom= Dictionary.ValueAtKey(rebar,"終端_下端筋径");
numberOfRib=Dictionary.ValueAtKey(rebar,"中央_肋筋本数");
# ----------------------------------------
rebarHostCover = StructuralDesign.Rebar.Properties.RebarHostCover(element=select_model_element)
element_types = ElementTypes("RebarBarType")
all_elements_of_type = ElementsOfType(element_type=element_types)
string_3 = StringInput("Type Name")
getParameterValueByName_3 = Element.GetParameterValueByName(element=all_elements_of_type, parameterName=string_3)
indexOf_2 = List.IndexOf(list=getParameterValueByName_3, element=code_block_8.diameterOfStirrup)
getItemAtIndex_4 = List.GetItemAtIndex(list=all_elements_of_type, index=indexOf_2)
string_4 = StringInput("Bar Diameter")
getParameterValueByName_4 = Element.GetParameterValueByName(element=getItemAtIndex_4, parameterName=string_4)
code_block_9 = CodeBlock(topCover=rebarHostCover.Top_Exterior, rebarStirrup=getParameterValueByName_4) { topCover+rebarStirrup; }
始端_上端筋_1段主筋本数 = Python(IN[0]=getParameterValueByName, IN[1]=code_block_8.mainStartUp1, IN[2]=code_block_9)
# ---------- 始端_上端筋_1段主筋本数.python (50 lines) ----------
# Load the Python Standard and DesignScript Libraries
import sys
import clr
clr.AddReference('ProtoGeometry')
from Autodesk.DesignScript.Geometry import *

# The inputs to this node will be stored as a list in the IN variables.
width = IN[0]
number=int(IN[1])
cover= IN[2]

widthRebar= width-2*cover
distance= 0
if(number-1>0):
    distance= widthRebar/(number-1)
listSpacing= []
isLeftFirst=True
spaceLeft=0
isRightFirst=True
spaceRight=0
if(number % 2==0):
    for i in range(0,number):
        if(i<=number/2-1):
            if(isLeftFirst):
                spaceLeft=distance/2
                listSpacing.append(spaceLeft)
                isLeftFirst=False
            else:
                 spaceLeft+=distance
                 listSpacing.append(spaceLeft)
        else:
            if(isRightFirst):
                spaceRight= -distance/2
                listSpacing.append(spaceRight)
                isRightFirst=False
            else:
                spaceRight-=distance
                listSpacing.append(spaceRight)
else:
    for i in range(0,number-1):
        if(i<(number-1)/2):
            spaceLeft+=distance
            listSpacing.append(spaceLeft)
        else:
            spaceRight-=distance
            listSpacing.append(spaceRight)
    listSpacing.append(0)

# Assign your output to the OUT variable.
OUT = listSpacing
# ----------------------------------------
translate = Geometry.Translate(geometry=trimByEndParameter, direction=firstItem, distance=始端_上端筋_1段主筋本数, lacing=Longest)
dot_3 = Vector.Dot(vector=filterByBoolMask.out, vec=normalized)
eq_3 = dot_3 == code_block
filterByBoolMask_3 = List.FilterByBoolMask(list=filterByBoolMask.out, mask=eq_3)
ZAxis_2 = Vector.ZAxis()
dot_4 = Vector.Dot(vector=filterByBoolMask_3.in, vec=ZAxis_2)
code_block_10 = CodeBlock { 0; }
lt = dot_4 < code_block_10
filterByBoolMask_4 = List.FilterByBoolMask(list=filterByBoolMask_3.in, mask=lt)
firstItem_3 = List.FirstItem(list=filterByBoolMask_4.in)
translate_2 = Geometry.Translate(geometry=translate, direction=firstItem_3, distance=code_block_9, lacing=Longest)
rebarStyle = RevitRebarStyle("Standard")
indexOf_3 = List.IndexOf(list=getParameterValueByName_3, element=code_block_8.rebarTypeStartUp)
getItemAtIndex_5 = List.GetItemAtIndex(list=all_elements_of_type, index=indexOf_3)
rebarHookType = RevitRebarHookType("鉄筋フック 90")
rebarHookType_2 = RevitRebarHookType("None")
rebarHookOrientation = RevitRebarHookOrientation("Right")
rebarHookOrientation_2 = RevitRebarHookOrientation("Right")
fromCurve = StructuralDesign.Rebar.Create.FromCurve(curve=translate_2, rebarStyle=rebarStyle, rebarBarType=getItemAtIndex_5, startHookType=rebarHookType, endHookType=rebarHookType_2, startHookOrientation=rebarHookOrientation, endHookOrientation=rebarHookOrientation_2, hostElement=select_model_element, vector=firstItem, lacing=Longest)
code_block_11 = CodeBlock(bottomCover=rebarHostCover.Bottom_Interior, rebarStirrup=getParameterValueByName_4) { bottomCover+rebarStirrup; }
始端_下端筋_1段主筋本数 = Python(IN[0]=getParameterValueByName, IN[1]=code_block_8.mainStartBottom1, IN[2]=code_block_11)  # same code as 始端_上端筋_1段主筋本数
translate_3 = Geometry.Translate(geometry=trimByEndParameter, direction=firstItem, distance=始端_下端筋_1段主筋本数, lacing=Longest)
string_5 = StringInput("Height")
getParameterValueByName_5 = Element.GetParameterValueByName(element=elementType, parameterName=string_5)
code_block_12 = CodeBlock(height=getParameterValueByName_5, cover=code_block_11) { height-cover; }
translate_4 = Geometry.Translate(geometry=translate_3, direction=firstItem_3, distance=code_block_12, lacing=Longest)
rebarStyle_2 = RevitRebarStyle("Standard")
indexOf_4 = List.IndexOf(list=getParameterValueByName_3, element=code_block_8.rabarTypeStartBottom1)
getItemAtIndex_6 = List.GetItemAtIndex(list=all_elements_of_type, index=indexOf_4)
rebarHookType_3 = RevitRebarHookType("鉄筋フック 90")
rebarHookType_4 = RevitRebarHookType("None")
rebarHookOrientation_3 = RevitRebarHookOrientation("Left")
rebarHookOrientation_4 = RevitRebarHookOrientation("Left")
fromCurve_2 = StructuralDesign.Rebar.Create.FromCurve(curve=translate_4, rebarStyle=rebarStyle_2, rebarBarType=getItemAtIndex_6, startHookType=rebarHookType_3, endHookType=rebarHookType_4, startHookOrientation=rebarHookOrientation_3, endHookOrientation=rebarHookOrientation_4, hostElement=select_model_element, vector=firstItem, lacing=Longest)
rebarStyle_3 = RevitRebarStyle("StirrupTie")
rebarHookType_5 = RevitRebarHookType("スターラップ/タイ フック - 135 度")
rebarHookOrientation_5 = RevitRebarHookOrientation("Left")
python_script = Python(IN[0]=getParameterValueByName, IN[1]=getParameterValueByName_5, IN[2]=rebarHostCover.Top_Exterior, IN[3]=rebarHostCover.Bottom_Interior, IN[4]=rebarHostCover.Other)
# ---------- python_script.python (33 lines) ----------
# Load the Python Standard and DesignScript Libraries
import sys
import clr
clr.AddReference('ProtoGeometry')
from Autodesk.DesignScript.Geometry import *

clr.AddReference('RevitNodes')
import Revit

clr.AddReference('RevitAPI')
import Autodesk.Revit.DB as DB

clr.ImportExtensions(Revit.GeometryConversion)
# The inputs to this node will be stored as a list in the IN variables.

width=IN[0]
height=IN[1]
coverTop= IN[2]
coverBottom=IN[3]
coverSide=IN[4]
point1= DB.XYZ(-width/2+coverSide, 0, -coverTop)
point2= DB.XYZ(width/2-coverSide,0,-coverTop)
point3= DB.XYZ(width/2-coverSide,0, -height+coverBottom)
point4= DB.XYZ(-width/2+coverSide,0,-height+coverBottom)
listPoint=[]
listPoint.append(Point.ByCoordinates(point1.X,point1.Y,point1.Z))
listPoint.append(Point.ByCoordinates(point2.X,point2.Y,point2.Z))
listPoint.append(Point.ByCoordinates(point3.X,point3.Y,point3.Z))
listPoint.append(Point.ByCoordinates(point4.X,point4.Y,point4.Z))
# Place your code below this line

# Assign your output to the OUT variable.
OUT =listPoint
# ----------------------------------------
boolean_2 = BoolSelector(true)
byPoints = PolyCurve.ByPoints(points=python_script, connectLastToFirst=boolean_2)
cross = Vector.Cross(vector=filterByBoolMask_4.out, cross=normalized)
reverse = Vector.Reverse(vector=direction)
byOriginVectors = CoordinateSystem.ByOriginVectors(origin=startPoint, xAxis=cross, yAxis=reverse, zAxis=filterByBoolMask_4.out)
transform = Geometry.Transform(geometry=byPoints, cs=byOriginVectors)
createRebarByPolyCurve = DynamoCsharp.Rebars.CreateRebarByPolyCurve(host=select_model_element, rebarStyle=rebarStyle_3, rebarType=getItemAtIndex_4, rebarHookTypeAtStart=rebarHookType_5, rebarHookTypeAtEnd=rebarHookType_5, rebarHookOrientationStart=rebarHookOrientation_5, rebarHookOrientationEnd=rebarHookOrientation_5, polyCure=transform)
length = Curve.Length(curve=getLocation)
boolean_3 = BoolSelector(false)
boolean_4 = BoolSelector(false)
setLayoutAsMaximumSpacing = StructuralDesign.Rebar.Layout.SetLayoutAsMaximumSpacing(rebar=createRebarByPolyCurve, spacing=code_block_8.distanceOfStirrup, arrayLength=length, barsOnNormalSide=boolean_3, includeFirstBar=boolean_4, includeLastBar=boolean_4)
始端_上端筋_2段主筋本数 = Python(IN[0]=getParameterValueByName, IN[1]=code_block_8.mainStartUp2, IN[2]=code_block_9)  # same code as 始端_上端筋_1段主筋本数
translate_5 = Geometry.Translate(geometry=trimByEndParameter, direction=firstItem, distance=始端_上端筋_2段主筋本数, lacing=Longest)
code_block_13 = CodeBlock(a=code_block_9) { a+100; }
translate_6 = Geometry.Translate(geometry=translate_5, direction=firstItem_3, distance=code_block_13, lacing=Longest)
rebarStyle_4 = RevitRebarStyle("Standard")
rebarHookType_6 = RevitRebarHookType("鉄筋フック 90")
rebarHookType_7 = RevitRebarHookType("None")
rebarHookOrientation_6 = RevitRebarHookOrientation("Right")
rebarHookOrientation_7 = RevitRebarHookOrientation("Right")
fromCurve_3 = StructuralDesign.Rebar.Create.FromCurve(curve=translate_6, rebarStyle=rebarStyle_4, rebarBarType=getItemAtIndex_5, startHookType=rebarHookType_6, endHookType=rebarHookType_7, startHookOrientation=rebarHookOrientation_6, endHookOrientation=rebarHookOrientation_7, hostElement=select_model_element, vector=firstItem, lacing=Longest)
始端_下端筋_2段主筋本数 = Python(IN[0]=getParameterValueByName, IN[1]=code_block_8.mainStartBottom2, IN[2]=code_block_11)  # same code as 始端_上端筋_1段主筋本数
translate_7 = Geometry.Translate(geometry=trimByEndParameter, direction=firstItem, distance=始端_下端筋_2段主筋本数, lacing=Longest)
code_block_14 = CodeBlock(first1=code_block_12) { first1-100; }
translate_8 = Geometry.Translate(geometry=translate_7, direction=firstItem_3, distance=code_block_14, lacing=Longest)
rebarStyle_5 = RevitRebarStyle("Standard")
rebarHookType_8 = RevitRebarHookType("鉄筋フック 90")
rebarHookType_9 = RevitRebarHookType("None")
rebarHookOrientation_8 = RevitRebarHookOrientation("Left")
rebarHookOrientation_9 = RevitRebarHookOrientation("Left")
fromCurve_4 = StructuralDesign.Rebar.Create.FromCurve(curve=translate_8, rebarStyle=rebarStyle_5, rebarBarType=getItemAtIndex_6, startHookType=rebarHookType_8, endHookType=rebarHookType_9, startHookOrientation=rebarHookOrientation_8, endHookOrientation=rebarHookOrientation_9, hostElement=select_model_element, vector=firstItem, lacing=Longest)
始端_上端筋_3段主筋本数 = Python(IN[0]=getParameterValueByName, IN[1]=code_block_8.mainStartUp3, IN[2]=code_block_9)  # same code as 始端_上端筋_1段主筋本数
translate_9 = Geometry.Translate(geometry=trimByEndParameter, direction=firstItem, distance=始端_上端筋_3段主筋本数, lacing=Longest)
code_block_15 = CodeBlock(a=code_block_13) { a+100; }
translate_10 = Geometry.Translate(geometry=translate_9, direction=firstItem_3, distance=code_block_15, lacing=Longest)
rebarStyle_6 = RevitRebarStyle("Standard")
rebarHookType_10 = RevitRebarHookType("鉄筋フック 90")
rebarHookType_11 = RevitRebarHookType("None")
rebarHookOrientation_10 = RevitRebarHookOrientation("Right")
rebarHookOrientation_11 = RevitRebarHookOrientation("Right")
fromCurve_5 = StructuralDesign.Rebar.Create.FromCurve(curve=translate_10, rebarStyle=rebarStyle_6, rebarBarType=getItemAtIndex_5, startHookType=rebarHookType_10, endHookType=rebarHookType_11, startHookOrientation=rebarHookOrientation_10, endHookOrientation=rebarHookOrientation_11, hostElement=select_model_element, vector=firstItem, lacing=Longest)
始端_下端筋_3段主筋本数 = Python(IN[0]=getParameterValueByName, IN[1]=code_block_8.mainStartBottom3, IN[2]=code_block_11)  # same code as 始端_上端筋_1段主筋本数
translate_11 = Geometry.Translate(geometry=trimByEndParameter, direction=firstItem, distance=始端_下端筋_3段主筋本数, lacing=Longest)
code_block_16 = CodeBlock(first2=code_block_14) { first2-100; }
translate_12 = Geometry.Translate(geometry=translate_11, direction=firstItem_3, distance=code_block_16, lacing=Longest)
rebarStyle_7 = RevitRebarStyle("Standard")
rebarHookType_12 = RevitRebarHookType("鉄筋フック 90")
rebarHookType_13 = RevitRebarHookType("None")
rebar_hook_orientation = RebarHookOrientation("Left", EnumerationType="Autodesk.Revit.DB.Structure.RebarHookOrientation, RevitAPI, Version=21.0.0.0, Culture=neutral, PublicKeyToken=null")
rebar_hook_orientation_2 = RebarHookOrientation("Left", EnumerationType="Autodesk.Revit.DB.Structure.RebarHookOrientation, RevitAPI, Version=21.0.0.0, Culture=neutral, PublicKeyToken=null")
fromCurve_6 = StructuralDesign.Rebar.Create.FromCurve(curve=translate_12, rebarStyle=rebarStyle_7, rebarBarType=getItemAtIndex_6, startHookType=rebarHookType_12, endHookType=rebarHookType_13, startHookOrientation=rebar_hook_orientation, endHookOrientation=rebar_hook_orientation_2, hostElement=select_model_element, vector=firstItem, lacing=Longest)
lengthRebarFromAtMiddle = CodeBlock { 1/4; }
lengthRebarToAtMiddle = CodeBlock { 3/4; }
trimByParameter = Curve.TrimByParameter(curve=getLocation, startParameter=lengthRebarFromAtMiddle, endParameter=lengthRebarToAtMiddle)
中央_上端筋_1段主筋本数 = Python(IN[0]=getParameterValueByName, IN[1]=code_block_8.mainMiddleTop1, IN[2]=code_block_9)  # same code as 始端_上端筋_1段主筋本数
translate_13 = Geometry.Translate(geometry=trimByParameter, direction=firstItem, distance=中央_上端筋_1段主筋本数, lacing=Longest)
translate_14 = Geometry.Translate(geometry=translate_13, direction=firstItem_3, distance=code_block_9, lacing=Longest)
rebarStyle_8 = RevitRebarStyle("Standard")
indexOf_5 = List.IndexOf(list=getParameterValueByName_3, element=code_block_8.rebarTypeMiddleTop)
getItemAtIndex_7 = List.GetItemAtIndex(list=all_elements_of_type, index=indexOf_5)
rebarHookType_14 = RevitRebarHookType("None")
rebarHookType_15 = RevitRebarHookType("None")
rebarHookOrientation_12 = RevitRebarHookOrientation("Left")
rebarHookOrientation_13 = RevitRebarHookOrientation("Left")
fromCurve_7 = StructuralDesign.Rebar.Create.FromCurve(curve=translate_14, rebarStyle=rebarStyle_8, rebarBarType=getItemAtIndex_7, startHookType=rebarHookType_14, endHookType=rebarHookType_15, startHookOrientation=rebarHookOrientation_12, endHookOrientation=rebarHookOrientation_13, hostElement=select_model_element, vector=firstItem, lacing=Longest)
中央_上端筋_2段主筋本数 = Python(IN[0]=getParameterValueByName, IN[1]=code_block_8.mainMiddleTop2, IN[2]=code_block_9)  # same code as 始端_上端筋_1段主筋本数
translate_15 = Geometry.Translate(geometry=trimByParameter, direction=firstItem, distance=中央_上端筋_2段主筋本数, lacing=Longest)
translate_16 = Geometry.Translate(geometry=translate_15, direction=firstItem_3, distance=code_block_13, lacing=Longest)
rebarStyle_9 = RevitRebarStyle("Standard")
rebarHookType_16 = RevitRebarHookType("None")
rebarHookType_17 = RevitRebarHookType("None")
rebarHookOrientation_14 = RevitRebarHookOrientation("Left")
rebarHookOrientation_15 = RevitRebarHookOrientation("Left")
fromCurve_8 = StructuralDesign.Rebar.Create.FromCurve(curve=translate_16, rebarStyle=rebarStyle_9, rebarBarType=getItemAtIndex_7, startHookType=rebarHookType_16, endHookType=rebarHookType_17, startHookOrientation=rebarHookOrientation_14, endHookOrientation=rebarHookOrientation_15, hostElement=select_model_element, vector=firstItem, lacing=Longest)
中央_上端筋_3段主筋本数 = Python(IN[0]=getParameterValueByName, IN[1]=code_block_8.mainMiddleTop3, IN[2]=code_block_9)  # same code as 始端_上端筋_1段主筋本数
translate_17 = Geometry.Translate(geometry=trimByParameter, direction=firstItem, distance=中央_上端筋_3段主筋本数, lacing=Longest)
translate_18 = Geometry.Translate(geometry=translate_17, direction=firstItem_3, distance=code_block_15, lacing=Longest)
rebarStyle_10 = RevitRebarStyle("Standard")
rebarHookType_18 = RevitRebarHookType("None")
rebarHookType_19 = RevitRebarHookType("None")
rebarHookOrientation_16 = RevitRebarHookOrientation("Left")
rebarHookOrientation_17 = RevitRebarHookOrientation("Left")
fromCurve_9 = StructuralDesign.Rebar.Create.FromCurve(curve=translate_18, rebarStyle=rebarStyle_10, rebarBarType=getItemAtIndex_7, startHookType=rebarHookType_18, endHookType=rebarHookType_19, startHookOrientation=rebarHookOrientation_16, endHookOrientation=rebarHookOrientation_17, hostElement=select_model_element, vector=firstItem, lacing=Longest)
中央_下端筋_1段主筋本数 = Python(IN[0]=getParameterValueByName, IN[1]=code_block_8.mainMiddleBottom1, IN[2]=code_block_11)  # same code as 始端_上端筋_1段主筋本数
translate_19 = Geometry.Translate(geometry=trimByParameter, direction=firstItem, distance=中央_下端筋_1段主筋本数, lacing=Longest)
translate_20 = Geometry.Translate(geometry=translate_19, direction=firstItem_3, distance=code_block_12, lacing=Longest)
rebarStyle_11 = RevitRebarStyle("Standard")
indexOf_6 = List.IndexOf(list=getParameterValueByName_3, element=code_block_8.rebarTypeMiddleBottom)
getItemAtIndex_8 = List.GetItemAtIndex(list=all_elements_of_type, index=indexOf_6)
rebarHookType_20 = RevitRebarHookType("None")
rebarHookType_21 = RevitRebarHookType("None")
rebarHookOrientation_18 = RevitRebarHookOrientation("Left")
rebarHookOrientation_19 = RevitRebarHookOrientation("Left")
fromCurve_10 = StructuralDesign.Rebar.Create.FromCurve(curve=translate_20, rebarStyle=rebarStyle_11, rebarBarType=getItemAtIndex_8, startHookType=rebarHookType_20, endHookType=rebarHookType_21, startHookOrientation=rebarHookOrientation_18, endHookOrientation=rebarHookOrientation_19, hostElement=select_model_element, vector=firstItem, lacing=Longest)
中央_下端筋_2段主筋本数 = Python(IN[0]=getParameterValueByName, IN[1]=code_block_8.mainMiddleBottom2, IN[2]=code_block_11)  # same code as 始端_上端筋_1段主筋本数
translate_21 = Geometry.Translate(geometry=trimByParameter, direction=firstItem, distance=中央_下端筋_2段主筋本数, lacing=Longest)
translate_22 = Geometry.Translate(geometry=translate_21, direction=firstItem_3, distance=code_block_14, lacing=Longest)
rebarStyle_12 = RevitRebarStyle("Standard")
rebarHookType_22 = RevitRebarHookType("None")
rebarHookType_23 = RevitRebarHookType("None")
rebarHookOrientation_20 = RevitRebarHookOrientation("Left")
rebarHookOrientation_21 = RevitRebarHookOrientation("Left")
fromCurve_11 = StructuralDesign.Rebar.Create.FromCurve(curve=translate_22, rebarStyle=rebarStyle_12, rebarBarType=getItemAtIndex_8, startHookType=rebarHookType_22, endHookType=rebarHookType_23, startHookOrientation=rebarHookOrientation_20, endHookOrientation=rebarHookOrientation_21, hostElement=select_model_element, vector=firstItem, lacing=Longest)
中央_下端筋_3段主筋本数 = Python(IN[0]=getParameterValueByName, IN[1]=code_block_8.mainMiddleBottom3, IN[2]=code_block_11)  # same code as 始端_上端筋_1段主筋本数
translate_23 = Geometry.Translate(geometry=trimByParameter, direction=firstItem, distance=中央_下端筋_3段主筋本数, lacing=Longest)
translate_24 = Geometry.Translate(geometry=translate_23, direction=firstItem_3, distance=code_block_16, lacing=Longest)
rebarStyle_13 = RevitRebarStyle("Standard")
rebarHookType_24 = RevitRebarHookType("None")
rebarHookType_25 = RevitRebarHookType("None")
rebarHookOrientation_22 = RevitRebarHookOrientation("Left")
rebarHookOrientation_23 = RevitRebarHookOrientation("Left")
fromCurve_12 = StructuralDesign.Rebar.Create.FromCurve(curve=translate_24, rebarStyle=rebarStyle_13, rebarBarType=getItemAtIndex_8, startHookType=rebarHookType_24, endHookType=rebarHookType_25, startHookOrientation=rebarHookOrientation_22, endHookOrientation=rebarHookOrientation_23, hostElement=select_model_element, vector=firstItem, lacing=Longest)
lengthRebarAtEnd = CodeBlock { 3/4; }
trimByStartParameter = Curve.TrimByStartParameter(curve=getLocation, startParameter=lengthRebarAtEnd)
reverse_2 = Curve.Reverse(curve=trimByStartParameter)
終端_上端筋_1段主筋本数 = Python(IN[0]=getParameterValueByName, IN[1]=code_block_8.mainEndUp1, IN[2]=code_block_9)  # same code as 始端_上端筋_1段主筋本数
translate_25 = Geometry.Translate(geometry=reverse_2, direction=firstItem, distance=終端_上端筋_1段主筋本数, lacing=Longest)
translate_26 = Geometry.Translate(geometry=translate_25, direction=firstItem_3, distance=code_block_9, lacing=Longest)
rebarStyle_14 = RevitRebarStyle("Standard")
indexOf_7 = List.IndexOf(list=getParameterValueByName_3, element=code_block_8.rebarTypeEndUp)
getItemAtIndex_9 = List.GetItemAtIndex(list=all_elements_of_type, index=indexOf_7)
rebarHookType_26 = RevitRebarHookType("鉄筋フック 90")
rebarHookType_27 = RevitRebarHookType("None")
rebarHookOrientation_24 = RevitRebarHookOrientation("Left")
rebarHookOrientation_25 = RevitRebarHookOrientation("Left")
fromCurve_13 = StructuralDesign.Rebar.Create.FromCurve(curve=translate_26, rebarStyle=rebarStyle_14, rebarBarType=getItemAtIndex_9, startHookType=rebarHookType_26, endHookType=rebarHookType_27, startHookOrientation=rebarHookOrientation_24, endHookOrientation=rebarHookOrientation_25, hostElement=select_model_element, vector=firstItem, lacing=Longest)
終端_上端筋_2段主筋本数 = Python(IN[0]=getParameterValueByName, IN[1]=code_block_8.mainEndUp2, IN[2]=code_block_9)  # same code as 始端_上端筋_1段主筋本数
translate_27 = Geometry.Translate(geometry=reverse_2, direction=firstItem, distance=終端_上端筋_2段主筋本数, lacing=Longest)
translate_28 = Geometry.Translate(geometry=translate_27, direction=firstItem_3, distance=code_block_13, lacing=Longest)
rebarStyle_15 = RevitRebarStyle("Standard")
rebarHookType_28 = RevitRebarHookType("鉄筋フック 90")
rebarHookType_29 = RevitRebarHookType("None")
rebarHookOrientation_26 = RevitRebarHookOrientation("Left")
rebarHookOrientation_27 = RevitRebarHookOrientation("Left")
fromCurve_14 = StructuralDesign.Rebar.Create.FromCurve(curve=translate_28, rebarStyle=rebarStyle_15, rebarBarType=getItemAtIndex_9, startHookType=rebarHookType_28, endHookType=rebarHookType_29, startHookOrientation=rebarHookOrientation_26, endHookOrientation=rebarHookOrientation_27, hostElement=select_model_element, vector=firstItem, lacing=Longest)
終端_上端筋_3段主筋本数 = Python(IN[0]=getParameterValueByName, IN[1]=code_block_8.mainEndUp3, IN[2]=code_block_9)  # same code as 始端_上端筋_1段主筋本数
translate_29 = Geometry.Translate(geometry=reverse_2, direction=firstItem, distance=終端_上端筋_3段主筋本数, lacing=Longest)
translate_30 = Geometry.Translate(geometry=translate_29, direction=firstItem_3, distance=code_block_15, lacing=Longest)
rebarStyle_16 = RevitRebarStyle("Standard")
rebarHookType_30 = RevitRebarHookType("鉄筋フック 90")
rebarHookType_31 = RevitRebarHookType("None")
rebarHookOrientation_28 = RevitRebarHookOrientation("Left")
rebarHookOrientation_29 = RevitRebarHookOrientation("Left")
fromCurve_15 = StructuralDesign.Rebar.Create.FromCurve(curve=translate_30, rebarStyle=rebarStyle_16, rebarBarType=getItemAtIndex_9, startHookType=rebarHookType_30, endHookType=rebarHookType_31, startHookOrientation=rebarHookOrientation_28, endHookOrientation=rebarHookOrientation_29, hostElement=select_model_element, vector=firstItem, lacing=Longest)
終端_下端筋_1段主筋本数 = Python(IN[0]=getParameterValueByName, IN[1]=code_block_8.mainEndBottom1, IN[2]=code_block_11)
# ---------- 終端_下端筋_1段主筋本数.python (48 lines) ----------
# Load the Python Standard and DesignScript Libraries
import sys
import clr
clr.AddReference('ProtoGeometry')
from Autodesk.DesignScript.Geometry import *

# The inputs to this node will be stored as a list in the IN variables.
width = IN[0]
number=int(IN[1])
cover= IN[2]

widthRebar= width-2*cover
distance= widthRebar/(number-1)
listSpacing= []
isLeftFirst=True
spaceLeft=0
isRightFirst=True
spaceRight=0
if(number % 2==0):
    for i in range(0,number):
        if(i<=number/2-1):
            if(isLeftFirst):
                spaceLeft=distance/2
                listSpacing.append(spaceLeft)
                isLeftFirst=False
            else:
                 spaceLeft+=distance
                 listSpacing.append(spaceLeft)
        else:
            if(isRightFirst):
                spaceRight= -distance/2
                listSpacing.append(spaceRight)
                isRightFirst=False
            else:
                spaceRight-=distance
                listSpacing.append(spaceRight)
else:
    for i in range(0,number-1):
        if(i<(number-1)/2):
            spaceLeft+=distance
            listSpacing.append(spaceLeft)
        else:
            spaceRight-=distance
            listSpacing.append(spaceRight)
    listSpacing.append(0)

# Assign your output to the OUT variable.
OUT = listSpacing
# ----------------------------------------
translate_31 = Geometry.Translate(geometry=reverse_2, direction=firstItem, distance=終端_下端筋_1段主筋本数, lacing=Longest)
translate_32 = Geometry.Translate(geometry=translate_31, direction=firstItem_3, distance=code_block_12, lacing=Longest)
rebarStyle_17 = RevitRebarStyle("Standard")
indexOf_8 = List.IndexOf(list=getParameterValueByName_3, element=code_block_8.rebarTypeEndBottom)
getItemAtIndex_10 = List.GetItemAtIndex(list=all_elements_of_type, index=indexOf_8)
rebarHookType_32 = RevitRebarHookType("鉄筋フック 90")
rebarHookType_33 = RevitRebarHookType("None")
rebarHookOrientation_30 = RevitRebarHookOrientation("Right")
rebarHookOrientation_31 = RevitRebarHookOrientation("Right")
fromCurve_16 = StructuralDesign.Rebar.Create.FromCurve(curve=translate_32, rebarStyle=rebarStyle_17, rebarBarType=getItemAtIndex_10, startHookType=rebarHookType_32, endHookType=rebarHookType_33, startHookOrientation=rebarHookOrientation_30, endHookOrientation=rebarHookOrientation_31, hostElement=select_model_element, vector=firstItem, lacing=Longest)
終端_下端筋_2段主筋本数 = Python(IN[0]=getParameterValueByName, IN[1]=code_block_8.mainEndBottom2, IN[2]=code_block_11)  # same code as 始端_上端筋_1段主筋本数
translate_33 = Geometry.Translate(geometry=reverse_2, direction=firstItem, distance=終端_下端筋_2段主筋本数, lacing=Longest)
translate_34 = Geometry.Translate(geometry=translate_33, direction=firstItem_3, distance=code_block_14, lacing=Longest)
rebarStyle_18 = RevitRebarStyle("Standard")
rebarHookType_34 = RevitRebarHookType("鉄筋フック 90")
rebarHookType_35 = RevitRebarHookType("None")
rebarHookOrientation_32 = RevitRebarHookOrientation("Right")
rebarHookOrientation_33 = RevitRebarHookOrientation("Right")
fromCurve_17 = StructuralDesign.Rebar.Create.FromCurve(curve=translate_34, rebarStyle=rebarStyle_18, rebarBarType=getItemAtIndex_10, startHookType=rebarHookType_34, endHookType=rebarHookType_35, startHookOrientation=rebarHookOrientation_32, endHookOrientation=rebarHookOrientation_33, hostElement=select_model_element, vector=firstItem, lacing=Longest)
終端_下端筋_3段主筋本数 = Python(IN[0]=getParameterValueByName, IN[1]=code_block_8.mainEndBottom3, IN[2]=code_block_11)  # same code as 始端_上端筋_1段主筋本数
translate_35 = Geometry.Translate(geometry=reverse_2, direction=firstItem, distance=終端_下端筋_3段主筋本数, lacing=Longest)
translate_36 = Geometry.Translate(geometry=translate_35, direction=firstItem_3, distance=code_block_16, lacing=Longest)
rebarStyle_19 = RevitRebarStyle("Standard")
rebarHookType_36 = RevitRebarHookType("鉄筋フック 90")
rebarHookType_37 = RevitRebarHookType("None")
rebarHookOrientation_34 = RevitRebarHookOrientation("Right")
rebarHookOrientation_35 = RevitRebarHookOrientation("Right")
fromCurve_18 = StructuralDesign.Rebar.Create.FromCurve(curve=translate_36, rebarStyle=rebarStyle_19, rebarBarType=getItemAtIndex_10, startHookType=rebarHookType_36, endHookType=rebarHookType_37, startHookOrientation=rebarHookOrientation_34, endHookOrientation=rebarHookOrientation_35, hostElement=select_model_element, vector=firstItem, lacing=Longest)
code_block_17 = CodeBlock {  }
transform_2 = Geometry.Transform(geometry=byPoints, cs=byOriginVectors)
python_script_2 = Python(IN[0]=python_script, IN[1]=code_block_8.numberOfRib)
# ---------- python_script_2.python (25 lines) ----------
# Load the Python Standard and DesignScript Libraries
import sys
import clr
clr.AddReference('ProtoGeometry')
from Autodesk.DesignScript.Geometry import *
#import Revit Api(C#)
clr.AddReference('RevitApi')
from Autodesk.Revit.DB import XYZ
#import libraby left of dynamo to use in python

listPoint = UnwrapElement(IN[0])
numberOfRib= IN[1]
width= listPoint[1].X-listPoint[0].X
number= int(numberOfRib-2)
spacing=0
listCurve=[]
if(number>0):
    spacing= width/(number+1)
for i in range(0,number):
    point1= Point.ByCoordinates(listPoint[0].X+spacing*(i+1),0,listPoint[0].Z)
    point2= Point.ByCoordinates(listPoint[0].X+spacing*(i+1),0,listPoint[3].Z)
    line= Line.ByStartPointEndPoint(point1,point2)
    listCurve.append(line)

OUT = listCurve
# ----------------------------------------
transform_3 = Geometry.Transform(geometry=python_script_2, cs=byOriginVectors, lacing=Longest)
rebarStyle_20 = RevitRebarStyle("StirrupTie")
rebarHookType_38 = RevitRebarHookType("スターラップ/タイ フック - 135 度")
rebarHookOrientation_36 = RevitRebarHookOrientation("Left")
fromCurve_19 = StructuralDesign.Rebar.Create.FromCurve(curve=transform_3, rebarStyle=rebarStyle_20, rebarBarType=getItemAtIndex_4, startHookType=rebarHookType_38, endHookType=rebarHookType_38, startHookOrientation=rebarHookOrientation_36, endHookOrientation=rebarHookOrientation_36, hostElement=select_model_element, vector=reverse, lacing=Longest)
boolean_5 = BoolSelector(false)
boolean_6 = BoolSelector(false)
setLayoutAsMaximumSpacing_2 = StructuralDesign.Rebar.Layout.SetLayoutAsMaximumSpacing(rebar=fromCurve_19, spacing=code_block_8.distanceOfStirrup, arrayLength=length, barsOnNormalSide=boolean_5, includeFirstBar=boolean_6, includeLastBar=boolean_6)
